# Grasshopper definition Rush_workFlow.gh (Grasshopper 1.0.7)
# plug-ins: DotsProj

path = FilePath("C:\nir_dev\MegaSavageLevel\rush\inputsToDots\rushPeripheralInput.csv")
geo = Geometry(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)
curve_skeleton = CrvSkeleton(
    InpFilePath=path,
    InpSiteCurve=geo,
    FromSiteOuterCirculationDepth=Slider(5.624, range=0..25),
    FromOuterCirculationBayDepth=Slider(20.823, range=0..25),
    FromBayDepthInnerCirculationDepth=Slider(5.317, range=0..25),
    SensitivityX100=Slider(2, range=0..10),
    OptimizationItrs=Slider(1, range=0..100))  # -> OuterOffsetCrv, InnerOffsetCrv, RESULTSegGeom, DebugString
geo_2 = Geometry(curve_skeleton.RESULTSegGeom)
Z = UnitZ(Factor=Slider(5.317, range=0..25))
extr = Extrude(Base=geo_2, Direction=Z)
geo_3 = Geometry(curve_skeleton.InnerOffsetCrv)
path_2 = FilePath("C:\nir_dev\MegaSavageLevel\rush\inputsToDots\rushIntermediateZoneInput.csv")
radial_zone_core = RadialZoneCore(
    InputFilesCsv=path_2,
    InputSiteCrv=geo_3,
    MoveCoreHorizontal=Slider(11.379, range=0..25),
    MoveCoreVertical=Slider(13.468, range=0..25),
    CoreAspectRatio=Slider(11.379, range=0..25),
    RotationInDegrees=Slider(13.468, range=0..25))  # -> SpatialCrv, CirculationLines, DebugText
panel = Panel(radial_zone_core.DebugText)
