# Grasshopper definition urban_plan_gen.gh (Grasshopper 1.0.7)
# plug-ins: DotsProj

crv = Curve(<curve referenced from the Rhino model>)  # disabled
parcel_subdiv = ParcelsBySubdivision(
    InputSite=crv,
    NumOfParcels=Slider(64, range=0..100),
    DevMean01=Slider(0.121, range=0..1),
    AngleAlignmentDegrees0360=Slider(360, range=0..360),
    ShowThisIterations=Slider(0, range=0..33),
    ResetAllValues=Toggle(True),
    Generate=Toggle(True))  # -> LowestDeviationOfParcelSolution, StreetCenterLines, OutputParcelFromRequiredIteration, OutputStreetFromRequiredIteration, NumberOfResults; disabled
crv_2 = Curve(parcel_subdiv.StreetCenterLines)
crv_3 = Curve(parcel_subdiv.OutputParcelFromRequiredIteration)
crv_4 = Curve(parcel_subdiv.OutputStreetFromRequiredIteration)
crv_5 = Curve(parcel_subdiv.LowestDeviationOfParcelSolution)
panel = Panel(parcel_subdiv.NumberOfResults)
circulation = GenerateCirculation(SiteCrvOuterBoundary=crv, CbspCrvs=crv_5, PartitionLines=crv_2, CirculationDepth=Slider(9, range=0..100))  # -> _0PartitionLines, _1CirculationPoly, _2ResultantCbspCrv; disabled
geo = Geometry(circulation._2ResultantCbspCrv)  # disabled
brep = Brep()
Z = UnitZ(Factor=1)
courtyard_mass = CourtyardMassing(
    SiteCurve=geo,
    FSRFAR=Slider(3, range=0..20),
    FloorHeight=Slider(3, range=0..20),
    Setback=Slider(0.975, range=0..20),
    BayDepth=Slider(6.974, range=0..100),
    MinFloorArea=Slider(0, range=0..1500))  # -> OutputFloorCurves, OutputMassingBreps; disabled
extr = Extrude(Base=brep, Direction=Z)
geo_2 = Geometry(courtyard_mass.OutputFloorCurves)
geo_3 = Geometry(courtyard_mass.OutputMassingBreps)

crv_6 = Curve(<curve referenced from the Rhino model>)  # disabled
crv_7 = Curve(<curve referenced from the Rhino model>)  # disabled
parcel_subdiv_diff = ParcelsBySubdivisionWithSubtraction(
    InputSite=crv_7,
    InternalCrv=crv_6,
    NumOfParcels=Slider(20, range=0..20),
    DevMean01=Slider(0, range=0..1),
    AngleAlignmentDegrees0360=Slider(0, range=0..360),
    ShowThisIterations=Slider(1, range=0..20),
    ResetAllValues=Toggle(True),
    Generate=Toggle(True))  # -> LowestDeviationOfParcelSolution, StreetCenterLines, OutputParcelFromRequiredIteration, OutputStreetFromRequiredIteration, NumberOfResults; disabled
crv_8 = Curve(parcel_subdiv_diff.LowestDeviationOfParcelSolution)
panel_2 = Panel(parcel_subdiv_diff.NumberOfResults)
crv_9 = Curve(parcel_subdiv_diff.OutputParcelFromRequiredIteration)
crv_10 = Curve(parcel_subdiv_diff.OutputStreetFromRequiredIteration)
crv_11 = Curve(parcel_subdiv_diff.StreetCenterLines)
Z_2 = UnitZ(Factor=Slider(4.209, range=0..10))
extr_2 = Extrude(Base=crv_8, Direction=Z_2)
brep_2 = Brep(crv_6)
brep_3 = Brep(extr_2)
circulation_2 = GenerateCirculation(SiteCrvOuterBoundary=crv_7, CbspCrvs=crv_8, PartitionLines=crv_11, CirculationDepth=Slider(15.502, range=0..20))  # -> _0PartitionLines, _1CirculationPoly, _2ResultantCbspCrv; disabled
preview = CustomPreview(Geometry=brep_2, Material=ColourSwatch(SwatchColor=RGB(235, 7, 7)))
preview_2 = CustomPreview(Geometry=brep_3, Material=ColourSwatch(SwatchColor=RGB(0, 0, 0)))
brep_4 = Brep()
crv_12 = Curve(circulation_2._0PartitionLines)
crv_13 = Curve(circulation_2._2ResultantCbspCrv)
preview_3 = CustomPreview(Geometry=brep_4, Material=ColourSwatch(SwatchColor=RGB(196, 162, 98)))
staggered_mass = StaggeredMassing(
    SiteCurve=crv_8,
    FloorHeightRequired=Slider(1.604, range=0..5),
    SetbackStepbacksForMassing="7,12",
    HeightsCorrespondingToStepbacks="20,50",
    MinArea=Slider(4.46, range=0..5))  # -> OutputFloorCurves, OutputMassingBreps, OutputTextPanelTotalFSRGFAAchieved, NumberOfFloors; disabled
geo_4 = Geometry(staggered_mass.OutputMassingBreps)

crv_14 = Curve(<curve referenced from the Rhino model>)  # disabled
peripheral_subdiv_parcel = PeripheralSubdivisionParcels(
    SiteCurve=crv_14,
    SetbackDimensionFromSite=Slider(9, range=0..20),
    BayDepthFromSetback=Slider(103, range=0..300),
    InnerCrv0ffsetFromBay=Slider(15, range=0..20),
    NumDiv=Slider(9, range=0..20))  # -> Setback, Bay, InnerCrv, ParcelCrv; disabled
number_slider = Slider(0, range=0..1)
crv_15 = Curve(peripheral_subdiv_parcel.ParcelCrv)
block = ExtrudeBlock(
    SiteCurve=crv_15,
    Setback=Slider(15.316, range=0..20),
    FsrFar=Slider(20, range=0..20),
    FLRHT=Slider(5.827, range=0..20),
    MinCrvArea=Slider(0, range=0..20000))  # -> OutputExtrudedMass, FloorCurves
geo_5 = Geometry(block.OutputExtrudedMass)
geo_6 = Geometry(block.FloorCurves)  # disabled

crv_16 = Curve(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)  # disabled
crv_17 = Curve(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)  # disabled
Z_3 = UnitZ(Factor=Slider(20, range=0..20))
extr_3 = Extrude(Base=crv_16, Direction=Z_3)
parcel_int_poly = ParcelsFromInternalPoly(InputSiteCurve=crv_17, InternalPolyine=crv_16)  # -> OutputParcels, OutputStreets; disabled
Z_4 = UnitZ(Factor=Slider(4.209, range=0..10))
crv_18 = Curve(parcel_int_poly.OutputParcels)
crv_19 = Curve(parcel_int_poly.OutputStreets)
extr_4 = Extrude(Base=crv_18, Direction=Z_4)
brep_5 = Brep(extr_3)
brep_6 = Brep(extr_4)
preview_4 = CustomPreview(Geometry=brep_5, Material=ColourSwatch(SwatchColor=RGB(235, 7, 7)))
circulation_3 = GenerateCirculation(SiteCrvOuterBoundary=crv_17, CbspCrvs=crv_18, PartitionLines=crv_19, CirculationDepth=Slider(4.972, range=0..10))  # -> _0PartitionLines, _1CirculationPoly, _2ResultantCbspCrv; disabled
preview_5 = CustomPreview(Geometry=brep_6, Material=ColourSwatch(SwatchColor=RGB(0, 0, 0)))
brep_7 = Brep(crv_16)
block_2 = ExtrudeBlock(
    SiteCurve=crv_18,
    Setback=Slider(10.996, range=0..20),
    FsrFar=Slider(3.596, range=0..20),
    FLRHT=Slider(3.364, range=0..20),
    MinCrvArea=Slider(106.409, range=0..200))  # -> OutputExtrudedMass, FloorCurves; disabled
crv_20 = Curve(circulation_3._0PartitionLines)
crv_21 = Curve(circulation_3._2ResultantCbspCrv)
preview_6 = CustomPreview(Geometry=brep_7, Material=ColourSwatch(SwatchColor=RGB(196, 162, 98)))
geo_7 = Geometry(block_2.FloorCurves)
geo_8 = Geometry(block_2.OutputExtrudedMass)

crv_22 = Curve(<curve referenced from the Rhino model>)  # disabled
parcel_subdiv_2 = ParcelsBySubdivision(
    InputSite=crv_22,
    NumOfParcels=Slider(64, range=0..100),
    DevMean01=Slider(0.121, range=0..1),
    AngleAlignmentDegrees0360=Slider(360, range=0..360),
    ShowThisIterations=Slider(0, range=0..33),
    ResetAllValues=Toggle(True),
    Generate=Toggle(True))  # -> LowestDeviationOfParcelSolution, StreetCenterLines, OutputParcelFromRequiredIteration, OutputStreetFromRequiredIteration, NumberOfResults; disabled
crv_23 = Curve(parcel_subdiv_2.StreetCenterLines)
crv_24 = Curve(parcel_subdiv_2.OutputParcelFromRequiredIteration)
crv_25 = Curve(parcel_subdiv_2.OutputStreetFromRequiredIteration)
panel_3 = Panel(parcel_subdiv_2.NumberOfResults)
crv_26 = Curve(parcel_subdiv_2.LowestDeviationOfParcelSolution)
circulation_4 = GenerateCirculation(SiteCrvOuterBoundary=crv_22, CbspCrvs=crv_26, PartitionLines=crv_23, CirculationDepth=Slider(9, range=0..100))  # -> _0PartitionLines, _1CirculationPoly, _2ResultantCbspCrv; disabled
crv_27 = Curve(crv_26)
geo_9 = Geometry(circulation_4._2ResultantCbspCrv)
Z_5 = UnitZ(Factor=Slider(4.209, range=0..10))
select = Select(
    InputSiteCrv=crv_22,
    Parcels=circulation_4._2ResultantCbspCrv,
    CentralizeOrDisperse=Toggle(False),
    OpenSpaceRequirement=Slider(26.756, range=0..100))  # -> OutputBuildableParcels, OutputOpenSpaceParcels; disabled
extr_5 = Extrude(Base=geo_9, Direction=Z_5)
brep_8 = Brep(extr_5)
crv_28 = Curve(select.OutputBuildableParcels)
crv_29 = Curve(select.OutputOpenSpaceParcels)
preview_7 = CustomPreview(Geometry=brep_8, Material=ColourSwatch(SwatchColor=RGB(0, 0, 0)))
block_3 = ExtrudeBlock(
    SiteCurve=crv_28,
    Setback=Slider(3.31, range=0..20),
    FsrFar=Slider(2.427, range=0..20),
    FLRHT=Slider(3.029, range=0..20),
    MinCrvArea=Slider(97.433, range=0..1500))  # -> OutputExtrudedMass, FloorCurves; disabled
courtyard_mass_2 = CourtyardMassing(
    SiteCurve=crv_29,
    FSRFAR=Slider(0.863, range=0..20),
    FloorHeight=Slider(20, range=0..20),
    Setback=Slider(1.64, range=0..20),
    BayDepth=Slider(10.019, range=0..100),
    MinFloorArea=Slider(0, range=0..1500))  # -> OutputFloorCurves, OutputMassingBreps; disabled
brep_9 = Brep(crv_29)
Z_6 = UnitZ(Factor=1)
geo_10 = Geometry(block_3.FloorCurves)
geo_11 = Geometry(block_3.OutputExtrudedMass)
geo_12 = Geometry(courtyard_mass_2.OutputMassingBreps)
extr_6 = Extrude(Base=brep_9, Direction=Z_6)

crv_30 = Curve(<curve referenced from the Rhino model>)  # disabled
peripheral_subdiv_parcel_2 = PeripheralSubdivisionParcels(
    SiteCurve=crv_30,
    SetbackDimensionFromSite=Slider(6.685, range=0..10),
    BayDepthFromSetback=Slider(27.703, range=0..50),
    InnerCrv0ffsetFromBay=Slider(8.163, range=0..10),
    NumDiv=Slider(42, range=0..100))  # -> Setback, Bay, InnerCrv, ParcelCrv; disabled
Z_7 = UnitZ(Factor=Slider(4.209, range=0..10))
crv_31 = Curve(peripheral_subdiv_parcel_2.Setback)
crv_32 = Curve(peripheral_subdiv_parcel_2.Bay)
crv_33 = Curve(peripheral_subdiv_parcel_2.InnerCrv)
crv_34 = Curve(peripheral_subdiv_parcel_2.ParcelCrv)
extr_7 = Extrude(Base=crv_34, Direction=Z_7)
brep_10 = Brep(crv_34)
brep_11 = Brep(extr_7)
preview_8 = CustomPreview(Geometry=brep_10, Material=ColourSwatch(SwatchColor=RGB(202, 230, 220)))
preview_9 = CustomPreview(Geometry=brep_11, Material=ColourSwatch(SwatchColor=RGB(0, 0, 0)))
crv_35 = Curve(crv_34)
brep_12 = Brep(crv_33)
courtyard_mass_3 = CourtyardMassing(
    SiteCurve=crv_35,
    FSRFAR=Slider(2.198, range=0.5..3),
    FloorHeight=Slider(3, range=0..10),
    Setback=Slider(2.957, range=0..25),
    BayDepth=Slider(8, range=0..20),
    MaxHtFloorArea=Slider(0, range=0..20))  # -> OutputFloorCurves, OutputMassingBreps
preview_10 = CustomPreview(Geometry=brep_12, Material=ColourSwatch(SwatchColor=RGB(196, 162, 98)))

crv_36 = Curve(<curve referenced from the Rhino model>)  # disabled
peripheral_subdiv_parcel_3 = PeripheralSubdivisionParcels(
    SiteCurve=crv_36,
    SetbackDimensionFromSite=Slider(20, range=0..20),
    BayDepthFromSetback=Slider(34.534, range=0..50),
    InnerCrv0ffsetFromBay=Slider(10, range=0..10),
    NumDiv=Slider(40, range=0..100))  # -> Setback, Bay, InnerCrv, ParcelCrv; disabled
crv_37 = Curve(peripheral_subdiv_parcel_3.Setback)
crv_38 = Curve(peripheral_subdiv_parcel_3.Bay)
crv_39 = Curve(peripheral_subdiv_parcel_3.InnerCrv)
crv_40 = Curve(peripheral_subdiv_parcel_3.ParcelCrv)

number_slider_2 = Slider(0, range=0..1)
crv_41 = Curve(crv_40)  # disabled
block_4 = ExtrudeBlock(
    SiteCurve=crv_41,
    Setback=Slider(4.617, range=0..20),
    FsrFar=Slider(6.806, range=0..20),
    FLRHT=Slider(3, range=0..3),
    MinCrvArea=Slider(0, range=0..20000))  # -> OutputExtrudedMass, FloorCurves; disabled
geo_13 = Geometry(block_4.OutputExtrudedMass)
geo_14 = Geometry(block_4.FloorCurves)

crv_42 = Curve([<curve referenced from the Rhino model> x351])  # disabled
ext_setbacks = UrbanMassingFromSiteFsrSetbacksStreets(
    InputSiteCurves=crv_42,
    StreetLayerNames="streeta, streetb",
    CorrespondingStreetSetbacks="5.5, 7.0",
    InputFSR=Slider(15, range=0..15))  # -> OutputSolidGeometry, OutputSITENumbers; disabled
geo_15 = Geometry(ext_setbacks.OutputSolidGeometry)
panel_4 = Panel(ext_setbacks.OutputSITENumbers)

crv_43 = Curve(<curve referenced from the Rhino model>)  # disabled
peripheral_subdiv_parcel_4 = PeripheralSubdivisionParcels(
    SiteCurve=crv_43,
    SetbackDimensionFromSite=Slider(3, range=0..10),
    BayDepthFromSetback=Slider(47.407, range=0..50),
    InnerCrv0ffsetFromBay=Slider(1.573, range=0..10),
    NumDiv=Slider(15, range=0..100))  # -> Setback, Bay, InnerCrv, ParcelCrv; disabled
number_slider_3 = Slider(0, range=0..20)
crv_44 = Curve(peripheral_subdiv_parcel_4.Setback)
crv_45 = Curve(peripheral_subdiv_parcel_4.Bay)
crv_46 = Curve(peripheral_subdiv_parcel_4.InnerCrv)
crv_47 = Curve(peripheral_subdiv_parcel_4.ParcelCrv)
number_slider_4 = Slider(20, range=0..20)
number_slider_5 = Slider(4, range=0..20)
number_slider_6 = Slider(2.198, range=0.5..3)
number_slider_7 = Slider(9.613, range=0..25)
number_slider_8 = Slider(3, range=0..10)
number_slider_9 = Slider(0.149, range=0..10)
number_slider_10 = Slider(0.726, range=0..5)
crv_48 = Curve(crv_47)
staggered_courtyard_normal = StaggeredCourtyardNormal(
    Site=crv_48,
    Setback=number_slider_10,
    BaseDepthOffset=number_slider_7,
    NumOfTowerFootprintsBaseCrvSubdiv=number_slider_4,
    NumberOfTowers=number_slider_5,
    FloorFloorHeight=number_slider_8,
    BaseFSRFAR=number_slider_6,
    TowerFSRFAR=number_slider_9,
    MinimumAreaSiteCrv=number_slider_3,
    MinimumAreaTowerCrv=number_slider_3)  # -> OffsetCurve, BaseFloorCurves, TowerFloorCurves, PolyFromSubDivOfCrvs, FinalBoundaryRepresentation; disabled
staggered_courtyard_interp = StaggeredCourtyardInterpolated(
    Site=crv_48,
    Setback=number_slider_10,
    BaseDepthOffset=number_slider_7,
    BaseDepthOffset_2=number_slider_4,
    NumberOfTowers=number_slider_5,
    FloorFloorHeight=number_slider_8,
    BaseFSRFAR=number_slider_6,
    TowerFSRFAR=number_slider_9,
    MinimumAreaSiteCrv=number_slider_3,
    MinimumAreaTowerCrv=number_slider_3)  # -> OffsetCurve, BaseFloorCurves, TowerFloorCurves, PolyFromSubDivOfCrvs, FinalBoundaryRepresentation; disabled
geo_16 = Geometry(staggered_courtyard_normal.FinalBoundaryRepresentation)
geo_17 = Geometry(staggered_courtyard_interp.FinalBoundaryRepresentation)

geo_18 = Geometry([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])
geo_19 = Geometry(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)
site_partition_circulation = SitePartitionCirculation(
    SiteCurve=geo_19,
    CirculationCurve=geo_18,
    CirculationDepth=Slider(2.337, range=0..10),
    MinimumAreaPartition=Slider(106.142, range=0..1000))  # -> DebugText, CirculationCurves, PartitionCurves
number_slider_11 = Slider(2.208, range=0..5)
crv_49 = Curve(site_partition_circulation.CirculationCurves)
crv_50 = Curve(site_partition_circulation.PartitionCurves)
panel_5 = Panel(site_partition_circulation.DebugText)
block_5 = MassingExtrudeBlock(
    SiteCurve=crv_50,
    Setback=Slider(1.604, range=0..5),
    FsrFar=Slider(3.23, range=0..5),
    FLRHT=Slider(2.099, range=0..5),
    MinCrvArea=Slider(4.46, range=0..5))  # -> OutputMassingBreps, OutputFloorCurves
courtyard_mass_4 = CourtyardMassing(
    SiteCurve=crv_50,
    FSRFAR=Slider(1.604, range=0..5),
    FloorHeight=Slider(3.23, range=0..5),
    Setback=Slider(1.179, range=0..5),
    BayDepth=Slider(4.998, range=0..12),
    MinFloorArea=Slider(2.208, range=0..5))  # -> OutputFloorCurves, OutputMassingBreps; disabled
staggered_courtyard_normal_2 = StaggeredCourtyardNormal(
    Site=crv_50,
    Setback=Slider(1.604, range=0..5),
    BaseDepthOffset=Slider(3.23, range=0..5),
    NumOfTowerFootprintsBaseCrvSubdiv=Slider(10, range=0..10),
    NumberOfTowers=Slider(2, range=0..10),
    FloorFloorHeight=Slider(4.46, range=0..5),
    BaseFSRFAR=Slider(2.208, range=0..5),
    TowerFSRFAR=Slider(1.236, range=0..5),
    MinimumAreaSiteCrv=number_slider_11,
    MinimumAreaTowerCrv=number_slider_11)  # -> OffsetCurve, BaseFloorCurves, TowerFloorCurves, PolyFromSubDivOfCrvs, FinalBoundaryRepresentation; disabled

staggered_mass_2 = StaggeredMassing(
    SiteCurve=crv_50,
    FloorHeightRequired=Slider(1.604, range=0..5),
    SetbackStepbacksForMassing="3,5,7",
    HeightsCorrespondingToStepbacks="3,5,7",
    MinArea=Slider(4.46, range=0..5))  # -> OutputFloorCurves, OutputMassingBreps, OutputTextPanelTotalFSRGFAAchieved, NumberOfFloors; disabled

Z_8 = UnitZ(Factor=Slider(0.534, range=0..10))
extr_8 = Extrude(Base=geo_18, Direction=Z_8)
brep_13 = Brep(crv_50)
brep_14 = Brep(extr_8)
preview_11 = CustomPreview(Geometry=brep_13, Material=ColourSwatch(SwatchColor=RGB(232, 138, 23)))
preview_12 = CustomPreview(Geometry=brep_14, Material=ColourSwatch(SwatchColor=RGB(0, 0, 0)))
geo_20 = Geometry(courtyard_mass_4.OutputMassingBreps)
geo_21 = Geometry(block_5.OutputMassingBreps)
brep_15 = Brep(geo_21)
brep_16 = Brep(geo_20)
preview_13 = CustomPreview(Geometry=brep_15, Material=ColourSwatch(SwatchColor=RGB(0, 242, 242)))
preview_14 = CustomPreview(Geometry=brep_16, Material=ColourSwatch(SwatchColor=RGB(0, 242, 242)))
