# Grasshopper definition test.gh (Grasshopper 1.0.7)
# plug-ins: BITS, DotsProj

flr_ht = Slider(3, range=1..5)
number_of_partitions = Slider(10, range=1..10)
number_courtyard_blocks = Slider(0, range=0..5)
setback = Slider(4, range=1..5)
panel = Panel("http://127.0.0.1:5000/api/get/partitions")
courtyard_block_depth = Slider(10, range=1..15)
run_or_not = BooleanToggle(True)
peripheral_depth = Slider(46, range=1..100)
fsr = Slider(4, range=1..5)
curve = Curve(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)
sample_ifc_json = SampleIfcJson(InputURL="https://apipw2.azurewebsites.net/", StartProcess=Toggle(True))
peripheralpartitions = PeripheralPartitions(
    SiteCurve=curve,
    Url="https://apipw2.azurewebsites.net/api/get/partitions",
    NumberOfPartitions=number_of_partitions,
    FloorSpaceRatio=fsr,
    FloorHeight=flr_ht,
    PeripheralDepth=peripheral_depth,
    Setback=setback,
    CourtyardBlockDepth=courtyard_block_depth,
    NumberOfCourtyardBlocks=number_courtyard_blocks,
    RunOrNot=run_or_not)  # -> Debug, DataObj, Parcels, Footprints, BuildingMassBlock, BuildingMassCourtyard
panel_2 = Panel(sample_ifc_json)
panel_3 = Panel(peripheralpartitions.Debug)
panel_4 = Panel(peripheralpartitions.DataObj)
geometry = Geometry(peripheralpartitions.Parcels)
geometry_2 = Geometry(peripheralpartitions.Footprints)
geometry_3 = Geometry(peripheralpartitions.BuildingMassCourtyard)
geometry_4 = Geometry(peripheralpartitions.BuildingMassBlock)
